# Dynamo graph Home.dyn (Dynamo 2.16.2.5624)

categories = Categories("OST_ElectricalFixtures")
all_elements_of_category = ElementsOfCategory(Category=categories)
code_block = CodeBlock { "ADSK_Номер помещения квартиры"; }
list_create = List.Create(item0=code_block)
getParameterValueByName = Element.GetParameterValueByName(element=all_elements_of_category, parameterName=list_create)
categories_2 = Categories("OST_MEPSpaces")
all_elements_of_category_2 = ElementsOfCategory(Category=categories_2)
getParameterValueByName_2 = Element.GetParameterValueByName(element=all_elements_of_category_2, parameterName=list_create)
geometry = Element.Geometry(element=all_elements_of_category_2)
geometry_2 = Element.Geometry(element=all_elements_of_category)
doesIntersect = Geometry.DoesIntersect(geometry=geometry, other=geometry_2)
equals = List.Equals(object=getParameterValueByName_2, otherObject=doesIntersect)
filterByBoolMask = List.FilterByBoolMask(list=getParameterValueByName, mask=equals)
setParameterByName = Element.SetParameterByName(element=filterByBoolMask.in, parameterName=getParameterValueByName_2, value=getParameterValueByName_2)
code_block_2 = CodeBlock {  }
