# Dynamo graph Kvartirografia-Zimovets.dyn "Kvartirografia1" (Dynamo 2.16.4.10216)

# note: l[0] - комнаты:
# Описание: Формируется список всех помещений (rooms), обработанных в скрипте. Каждое помещение представлено в формате room.
# Параметр для записи: Не требуется, это просто список элементов.
# l[1] - Категория (номер квартиры + тип помещения):
# Описание: Категория для каждой комнаты формируется как строка, объединяющая номер квартиры (ADSK_Номер квартиры) и тип помещения (ADSK_Тип помещения).
# Параметр для записи: Не требуется, используется для внутренней логики.
# l[2] - Номер квартиры:
# Описание: Это номер квартиры (aptNum), извлекаемый из параметра ADSK_Номер квартиры.
# Параметр для записи: Не требуется, это значение берётся из параметра ADSK_Номер квартиры в Revit.
# l[3] - Общая площадь квартиры с коэффициентом "ADSK_Площадь с коэффициентом":
# Описание: Общая площадь квартиры с применением коэффициентов.
# Параметр для записи: ADSK_Площадь с коэффициентом.
# l[4] - Жилая площадь квартиры "ADSK_Площадь квартиры жилая":
# Описание: Жилая площадь вычисляется только для жилых помещений (тип 1).
# Параметр для записи: ADSK_Площадь квартиры жилая.
# l[5] - Общая площадь квартиры "ADSK_Площадь квартиры общая":
# Описание: Общая площадь всех помещений, включая жилые и нежилые.
# Параметр для записи: ADSK_Площадь квартиры общая.
# l[6] - Коэффициент площади комнаты:
# Описание: Коэффициент площади комнаты в зависимости от её типа:
# Тип 5: 0 (общее помещение),
# Тип 3: 0.5 (лоджия),
# Тип 4: 0.3 (балкон),
# Другие: 1.
# Параметр для записи: Не требуется, коэффициент вычисляется в скрипте и используется для расчётов.
# l[7] - Площадь комнаты, умноженная на коэффициент:
# Описание: Результат умножения площади комнаты на её коэффициент.
# Параметр для записи: Не требуется, коэффициент вычисляется в скрипте и используется для расчётов.
# note: ADSK_Номер квартиры
# note: ADSK_Этаж

categories = Categories("OST_Rooms")  # graph input
all_elements_of_category = ElementsOfCategory(Category=categories)  # "All Elements of Category-Получение элементов из модели"
watch_проверка_l_0 = Watch(all_elements_of_category)
code_block_основные_параметры = CodeBlock { "ADSK_Номер квартиры"; "ADSK_Тип помещения"; "ADSK_Этаж"; }
getparameter_adsk_номер_квартиры = Element.GetParameterValueByName(element=watch_проверка_l_0, parameterName=code_block_основные_параметры.out0)
getparameter_adsk_этаж = Element.GetParameterValueByName(element=watch_проверка_l_0, parameterName=code_block_основные_параметры.out2)
getparameter_adsk_тип_помещения = Element.GetParameterValueByName(element=watch_проверка_l_0, parameterName=code_block_основные_параметры.out1)
округлить_до___знаков = CodeBlock { 2; }
python_script_основной_расчет = Python(IN[0]=watch_проверка_l_0, IN[1]=getparameter_adsk_номер_квартиры, IN[2]=getparameter_adsk_этаж, IN[3]=getparameter_adsk_тип_помещения, IN[4]=округлить_до___знаков)  # CPython3
# ---------- python_script_основной_расчет.python (112 lines) ----------
import clr

# Инициализация массивов для хранения данных
apartIndexes = []  # Массив индексов квартир (номер + этаж)
aparts = []  # Массив данных по квартирам: [количество жилых комнат, общая площадь с коэффициентом, жилая площадь, общая площадь, общее количество помещений]
roomsAreaCoeff = []
roomsAreaMultipliedByCoeff = []
roomsArea = []
outRooms = []  # Список комнат для вывода

# Входные данные
rooms = IN[0]  # Список комнат
parAptNumber = IN[1] if len(IN) > 1 else []  # Номер квартиры (ADSK_Номер квартиры)
parAptFloor = IN[2] if len(IN) > 2 else []  # Этаж квартиры (ADSK_Этаж)
parAptTip = IN[3] if len(IN) > 3 else []  # Тип помещения
roundCount = IN[4] if len(IN) > 4 else 2  # Округление площади

# Проверка входных данных
if not rooms or not parAptNumber or not parAptTip or not parAptFloor:
    raise ValueError("Входные данные некорректны или отсутствуют")

# Перебор комнат для подсчёта общей и жилой площади на каждую квартиру
for i, room in enumerate(rooms): 
    try:
        uroom = UnwrapElement(room)  # Получаем элемент комнаты из Revit
        if i >= len(parAptNumber) or i >= len(parAptTip) or i >= len(parAptFloor):
            print(f"Пропуск комнаты {i}: отсутствуют данные для номера квартиры, типа помещения или этажа")
            continue

        aptNum = parAptNumber[i]  # Номер квартиры
        aptFloor = parAptFloor[i]  # Этаж квартиры
        room_type = parAptTip[i]  # Тип помещения
        aptIndex = f"{aptNum}_{aptFloor}"  # Уникальный индекс для квартиры (номер + этаж)
        
        area = round(uroom.Area * 0.09290304, roundCount) if uroom.Area else 0  # Площадь комнаты
        koeff = 1  # Начальное значение коэффициента

        # Применение коэффициента в зависимости от типа помещения
        if room_type == 5:  # Общее помещение
            koeff = 0
        elif room_type == 3:  # Лоджия
            koeff = 0.5
        elif room_type == 4:  # Балкон
            koeff = 0.3
        
        karea = round(koeff * area, roundCount)  # Площадь комнаты с коэффициентом
        
        # Проверка, есть ли квартира с таким индексом в списке
        if aptIndex in apartIndexes:
            index = apartIndexes.index(aptIndex)  # Индекс квартиры
            if room_type == 1:  # Жилое помещение
                aparts[index][0] += 1  # Увеличиваем количество жилых комнат
                aparts[index][2] += area  # Добавляем к жилой площади
            aparts[index][1] += karea  # Добавляем площадь с коэффициентом к общей площади квартиры
            aparts[index][3] += area  # Добавляем к общей площади квартиры
            aparts[index][4] += 1  # Увеличиваем общее количество помещений
        else:
            # Добавляем новую запись для квартиры
            apartIndexes.append(aptIndex)
            aptRoomsCount = 1 if room_type == 1 else 0  # Если тип помещения "Жилое", количество комнат = 1
            uarea = area if room_type == 1 else 0  # Если тип помещения "Жилое", жилая площадь = area
            apartarea = area  # Общая площадь квартиры (для всех типов)
            totalRoomsCount = 1  # Начальное количество помещений
            aparts.append([aptRoomsCount, karea, uarea, apartarea, totalRoomsCount])  # Добавляем квартиру в список
            
        # Добавление значений коэффициента и площади
        roomsAreaCoeff.append(koeff)
        roomsAreaMultipliedByCoeff.append(karea)
        roomsArea.append(area)
    except Exception as e:
        print(f"Ошибка при обработке комнаты {i}: {e}")

# Формирование выходных данных для каждой комнаты
for i, room in enumerate(rooms):
    try:
        uroom = UnwrapElement(room)
        if i >= len(parAptNumber) or i >= len(parAptTip) or i >= len(parAptFloor):
            print(f"Пропуск комнаты {i}: отсутствуют данные для номера квартиры, типа помещения или этажа")
            continue
        
        aptNum = parAptNumber[i]
        aptFloor = parAptFloor[i]
        aptIndex = f"{aptNum}_{aptFloor}"  # Уникальный индекс квартиры
        aptPos = apartIndexes.index(aptIndex) if aptIndex in apartIndexes else -1
        if aptPos > -1 and uroom.Area: 
            apt = aparts[aptPos]  # Данные по квартире
            outRooms.append([
                room,
                f"{aptNum}_{str(parAptTip[i])}",  # Категория
                apt[0],  # Количество жилых комнат
                apt[1],  # Общая площадь квартиры с коэффициентом
                apt[2],  # Жилая площадь квартиры
                apt[3],  # Общая площадь квартиры
                apt[4],  # Общее количество помещений
                roomsAreaCoeff[i],  # Коэффициент площади комнаты
                roomsAreaMultipliedByCoeff[i],  # Площадь комнаты с коэффициентом
                roomsArea[i]  # Площадь комнаты
            ])
    except Exception as e:
        print(f"Ошибка при формировании выходных данных для комнаты {i}: {e}")

OUT = outRooms
# На выходе 9 списков:
# l[0] - комнаты
# l[1] - Категория
# l[2] - Количество жилых комнат
# l[3] - Общая площадь квартиры с коэффициентом
# l[4] - Жилая площадь квартиры
# l[5] - Общая площадь квартиры
# l[6] - Общее количество помещений
# l[7] - Коэффициент площади комнаты
# l[8] - Площадь комнаты, умноженная на коэффициент
# ----------------------------------------
# note: ADSK_Тип помещения
list_transpose_обработка_данных = List.Transpose(lists=python_script_основной_расчет)
watch_проверка_l_0_2 = Watch(list_transpose_обработка_данных)
code_block_список_на_выходе = CodeBlock(l=watch_проверка_l_0_2) { l[0]; l[1]; l[2]; l[3]; l[4]; l[5]; l[6]; l[7]; l[8]; }
parameters_список_для_записи = CodeBlock()
# ---------- parameters_список_для_записи.designscript (5 lines) ----------
"ADSK_Номер квартиры";
"ADSK_Количество комнат";
"ADSK_Площадь с коэффициентом";
"ADSK_Площадь квартиры жилая";
"ADSK_Площадь квартиры общая";
# ----------------------------------------
setparameter_adsk_площадь = Element.SetParameterByName(element=code_block_список_на_выходе.out0, parameterName=parameters_список_для_записи.out3, value=code_block_список_на_выходе.out4)  # "SetParameter - ADSK_Площадь квартиры жилая"
setparameter_adsk_площадь_с = Element.SetParameterByName(element=code_block_список_на_выходе.out0, parameterName=parameters_список_для_записи.out2, value=code_block_список_на_выходе.out3)  # "SetParameter - ADSK_Площадь с коэффициентом"
setparameter_adsk_количество = Element.SetParameterByName(element=code_block_список_на_выходе.out0, parameterName=parameters_список_для_записи.out1, value=code_block_список_на_выходе.out2)  # "SetParameter - ADSK_Количество комнат"
setparameter_adsk_площадь_2 = Element.SetParameterByName(element=code_block_список_на_выходе.out0, parameterName=parameters_список_для_записи.out4, value=code_block_список_на_выходе.out5)  # "SetParameter - ADSK_Площадь квартиры общая"
# note: # На выходе 9 списков:
# # l[0] - комнаты
# # l[1] - Категория
# # l[2] - Количество жилых комнат
# # l[3] - Общая площадь квартиры с коэффициентом
# # l[4] - Жилая площадь квартиры
# # l[5] - Общая площадь квартиры
# # l[6] - Общее количество помещений
# # l[7] - Коэффициент площади комнаты
# # l[8] - Площадь комнаты, умноженная на коэффициент
code_block = CodeBlock {  }
